# Grasshopper definition 2D_Truss.gh (Grasshopper 1.0.7)
# plug-ins: VGS1.00beta

number_slider = Slider(1, range=0..10)
number_slider_2 = Slider(1, range=0..10)
division = Division(A=number_slider, B=2)
division_2 = Division(A=number_slider_2, B=2)
Y = UnitY(Factor=number_slider)
Y_2 = UnitY(Factor=division)
Y_3 = UnitY(Factor=number_slider_2)
Y_4 = UnitY(Factor=division_2)
pt = Point([<point referenced from the Rhino model> x38])
pt_2 = Point([<point referenced from the Rhino model> x4])
crv = Curve([<curve referenced from the Rhino model> x81])
pt_3 = Point([<point referenced from the Rhino model> x40])
pt_4 = Point(<point referenced from the Rhino model>)
pt_5 = Point(<point referenced from the Rhino model>)
pt_6 = Point([<point referenced from the Rhino model> x36])
pt_7 = Point([<point referenced from the Rhino model> x4])
crv_2 = Curve([<curve referenced from the Rhino model> x134])
pt_8 = Point([<point referenced from the Rhino model> x57])
pt_9 = Point(<point referenced from the Rhino model>)
pt_10 = Point(<point referenced from the Rhino model>)
loads = _2LoadsVGS(AppPt=pt, ForceVec=expr("-x", Y))
loads_2 = _2LoadsVGS(AppPt=pt_2, ForceVec=expr("-x", Y_2))
loads_3 = _2LoadsVGS(AppPt=pt_6, ForceVec=expr("-x", Y_3))
loads_4 = _2LoadsVGS(AppPt=pt_7, ForceVec=expr("-x", Y_4))
supports = _3SupportsVGS(Pt=pt_3, XYZ="Z")
supports_2 = _3SupportsVGS(Pt=pt_4, XYZ="YZ")
supports_3 = _3SupportsVGS(Pt=pt_5, XYZ="XYZ")
supports_4 = _3SupportsVGS(Pt=pt_8, XYZ="Z")
supports_5 = _3SupportsVGS(Pt=pt_9, XYZ="YZ")
supports_6 = _3SupportsVGS(Pt=pt_10, XYZ="XYZ")
edges = _1EdgesVGS(Ln=crv)
edges_2 = _1EdgesVGS(Ln=crv_2)
structural_model = _5StructuralModelVGS(Edge=edges, Load=[loads, loads_2], Support=[supports, supports_2, supports_3])
structural_model_2 = _5StructuralModelVGS(Edge=edges_2, Load=[loads_3, loads_4], Support=[supports_4, supports_5, supports_6])
int = Integer([1, 2, 3, 4, 5, 6, 7, 8, 9, 10, 11, 12, 13, 14, 15, 16, 17, 18, 78])
self_stresses = _4SelfStressesVGS(Index=int, Mag=0)
evaluate_equilibrium = _6EvaluateEquilibriumVGS(Model=structural_model, MatrRank=Toggle(True))  # -> IntForce, ExtForce, Model
evaluate_equilibrium_2 = _6EvaluateEquilibriumVGS(Model=structural_model_2, SelfStress=self_stresses, MatrRank=Toggle(True))  # -> IntForce, ExtForce, Model
panel = Panel(evaluate_equilibrium.Model)
panel_2 = Panel(evaluate_equilibrium_2.Model)
assemble_form_diagram = _3AssembleFormDiagramVGS(IntForce=evaluate_equilibrium.IntForce, ExtForce=evaluate_equilibrium.ExtForce)
assemble_form_diagram_2 = _3AssembleFormDiagramVGS(IntForce=evaluate_equilibrium_2.IntForce, ExtForce=evaluate_equilibrium_2.ExtForce)
generate_force_diagram = _4GenerateForceDiagramVGS(F=assemble_form_diagram, GlobEq=True, Reset=Button(), FormFinding=False)
generate_force_diagram_2 = _4GenerateForceDiagramVGS(F=assemble_form_diagram_2, GlobEq=True, Reset=Button(), FormFinding=False)
pt_11 = Point(<point referenced from the Rhino model>)
pt_12 = Point(<point referenced from the Rhino model>)
locate_diagram = _2LocateDiagramVGS(FF=generate_force_diagram, LocPt=pt_11)
locate_diagram_2 = _2LocateDiagramVGS(FF=generate_force_diagram_2, LocPt=pt_12)
visualize_diagrams = _1VisualizeDiagramsVGS(
    FF=assemble_form_diagram,
    ThickLn=1,
    ThickLnVar=0.5,
    SizeTxt=0.1,
    NodeID=2147483647,
    display_Edge_line=True,
    display_Edge_text=True,
    display_Load_line=True,
    display_Load_text=True,
    display_Node_circle=False,
    display_Node_text=False,
    display_React_line=False,
    display_React_text=False,
    display_Result_line=False,
    display_Result_text=False)
visualize_diagrams_2 = _1VisualizeDiagramsVGS(
    FF=locate_diagram,
    ThickLn=0,
    ThickLnVar=1,
    SizeTxt=0.3,
    NodeID=2147483647,
    display_Edge_line=True,
    display_Edge_text=True,
    display_Load_line=True,
    display_Load_text=True,
    display_Node_circle=False,
    display_Node_text=False,
    display_React_line=False,
    display_React_text=False,
    display_Result_line=False,
    display_Result_text=False)
visualize_diagrams_3 = _1VisualizeDiagramsVGS(
    FF=assemble_form_diagram_2,
    ThickLn=1,
    ThickLnVar=0.5,
    SizeTxt=0.1,
    NodeID=2147483647,
    display_Edge_line=True,
    display_Edge_text=True,
    display_Load_line=True,
    display_Load_text=True,
    display_Node_circle=False,
    display_Node_text=False,
    display_React_line=False,
    display_React_text=False,
    display_Result_line=False,
    display_Result_text=False)
visualize_diagrams_4 = _1VisualizeDiagramsVGS(
    FF=locate_diagram_2,
    ThickLn=0,
    ThickLnVar=1,
    SizeTxt=0.3,
    NodeID=2147483647,
    display_Edge_line=True,
    display_Edge_text=True,
    display_Load_line=True,
    display_Load_text=True,
    display_Node_circle=False,
    display_Node_text=False,
    display_React_line=False,
    display_React_text=False,
    display_Result_line=False,
    display_Result_text=False)
