# Grasshopper definition 3D_SuspensionBridge.gh (Grasshopper 1.0.7)
# plug-ins: CEM_Deviation_2.0, CEM_Trail_2.0, CEM_Build_Topology_2.0, CEM_Load_2.0, CEM_Support_2.0, CEM_Calculate_Structure_2.0, CEM_Extract_Structure_2.0, CEM_Extract_Topology_2.0, CEM_Origin_Node_2.0, VGS1.00beta, Kangaroo2 Components

# ----
# Click to initialize
button = Button()

Y = UnitY(Factor=200)
number_slider = Slider(0.8, range=0..1)
simp = Slider(5.78, range=0..8)

panel = Panel("""Q0
Q1
Q2
Q3
Q4
Q5
Q6
Q7
Q8
Q9
Q10
Q11
Q12
Q13
Q14
Q15
Q16
Q17
Q18
Q19
Q20
Q21""")
panel_2 = Panel("""v47
v49""")

geo = Geometry([<point referenced from the Rhino model> x52, <curve referenced from the Rhino model> x98, <point referenced from the Rhino model>, <curve referenced from the Rhino model> x2])
id = Guid(geo)
pt = Point(<point referenced from the Rhino model>)
pt_2 = Point(<point referenced from the Rhino model>)
constrain_external_force = _4ConstrainExternalForceVGS(ExtForceID=panel, Strength=10, ADL0=False, ADL1=True, ADL2=True, ADL3=False)
constrain_node = _6ConstrainNodeVGS(NodesID=panel_2, Strength=10, XYZ0=True, XYZ1=False, XYZ2=False)
panel_3 = Panel("""v46
v43""")
panel_4 = Panel("""v48
v45""")
number_slider_2 = Slider(0.1, range=0.1..5)
merge = Merge(Data1=constrain_external_force, Data2=constrain_node)
Y_2 = UnitY(Factor=simp)
constrain_node_2 = _6ConstrainNodeVGS(NodesID="V44", Strength=10, XYZ0=True, XYZ1=True, XYZ2=True)
panel_5 = Panel("""e42
e38
e34
e30
e26
e22
e18
e14
e10
e6
e2
e68
e4
e8
e12
e16
e20
e24
e28
e32
e36
e40
e44""")
number_slider_3 = Slider(1.5, range=0.1..3)
rgb = ColourRGB(Alpha=10, Red=0, Green=0, Blue=0)

trailedge = Curve(flatten([<curve referenced from the Rhino model> x2]))
trailedge_2 = Curve(flatten([<curve referenced from the Rhino model> x2]))
trailedge_3 = Curve(flatten([<curve referenced from the Rhino model> x22]))
pointload = Point(flatten([<point referenced from the Rhino model> x22]))
trailedge_4 = Curve(flatten([<curve referenced from the Rhino model> x22]))
deviationedge = Curve(flatten(<curve referenced from the Rhino model>))
deviationedge_2 = Curve(flatten([<curve referenced from the Rhino model> x2]))
deviationedge_3 = Curve(flatten([<curve referenced from the Rhino model> x22]))
deviationedge_4 = Curve(flatten(<curve referenced from the Rhino model>))

item = ListItem(List=trailedge_4, Index=0, Wrap=True)  # -> Item1, Item
end = EndPoints(Curve=flatten([item.Item1, item.Item]))  # -> Start, End
end_2 = EndPoints(Curve=trailedge_2)  # -> Start, End
end_3 = EndPoints(Curve=trailedge)  # -> Start, End
pt_3 = Point(end_2.End)
pt_4 = Point(end_3.End)
pt_5 = Point(end.End)

support = Point(flatten([pt_3, pt_5, pt_4]))

cem_deviation_2_0 = CEM_Deviation_20(DeviationEdge=deviationedge_2, DeviationMagn=Slider(-34.4, range=-40..10))
cem_deviation_2_0_2 = CEM_Deviation_20(DeviationEdge=deviationedge, DeviationMagn=Slider(20, range=-20..20))
cem_deviation_2_0_3 = CEM_Deviation_20(DeviationEdge=deviationedge_4, DeviationMagn=Slider(-40, range=-40..10))
cem_support_2_0 = CEM_Support_20(Support=support)
cem_deviation_2_0_4 = CEM_Deviation_20(DeviationEdge=deviationedge_3, DeviationMagn=Slider(1, range=-20..10))
cem_load_2_0 = CEM_Load_20(
    PointLoad=pointload,
    LoadMagnX=Slider(0, range=-10..10),
    LoadMagnY=Slider(0, range=-10..10),
    LoadMagnZ=Slider(-1, range=-10..10))
cem_trail_2_0 = CEM_Trail_20(TrailEdge=trailedge_2, TrailLen=Slider(20, range=-10..20))
cem_trail_2_0_2 = CEM_Trail_20(TrailEdge=trailedge_4, TrailLen=Slider(-3, range=-10..10))
cem_trail_2_0_3 = CEM_Trail_20(TrailEdge=trailedge, TrailLen=Slider(0, range=-10..10))
cem_trail_2_0_4 = CEM_Trail_20(TrailEdge=trailedge_3, TrailLen=Slider(3, range=-10..10))
cem_build_topology_2_0 = CEM_Build_Topology_20(
    T=flatten([cem_trail_2_0_3, cem_trail_2_0_2, cem_trail_2_0, cem_trail_2_0_4]),
    L=flatten(cem_load_2_0),
    D=flatten([cem_deviation_2_0_4, cem_deviation_2_0_3, cem_deviation_2_0_2, cem_deviation_2_0]),
    S=flatten(cem_support_2_0))
cem_extract_topology_2_0 = CEM_Extract_Topology_20(TP=cem_build_topology_2_0)  # -> Nodes, NodesID, Trails, TrailsID, Deviations, DeviationsID, AuxTrails, AuxTrailsID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
move = Move(Geometry=cem_extract_topology_2_0.OriginNode, Motion=Y)  # -> Geometry, Transform
cem_origin_node_2_0 = CEM_Origin_Node_20(OriginNode=move.Geometry, OriginNodeID=cem_extract_topology_2_0.OriginNodeID)
cem_calculate_structure_2_0 = CEM_Calculate_Structure_20(MarshallingSignalParameter=cem_build_topology_2_0, N=cem_origin_node_2_0)
cem_extract_structure_2_0 = CEM_Extract_Structure_20(M=cem_calculate_structure_2_0)  # -> Nodes, NodesID, Trails, TrailsID, TrailsCol, TrailsMag, Deviations, DeviationsID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
multiplication = Multiplication(A=cem_extract_structure_2_0.DeviationsMag, B=number_slider)
multiplication_2 = Multiplication(A=cem_extract_structure_2_0.TrailsMag, B=number_slider)
c_script = CSharpScript(lns=cem_extract_structure_2_0.ExternalForces, rate=number_slider)  # -> out, A; inputs lns: list of Line, rate: Double
# ---------- c_script: C# ----------
    List<Line> f_lns = new List<Line>();
    foreach(Line ln in lns)
    {
      if(ln.Length > 0.0001){ f_lns.Add(ln);}
    }

    List<Line> c_lns = new List<Line>();
    foreach(Line ln in f_lns)
    {
      Vector3d vec = new Vector3d(ln.To - ln.From);
      vec.Unitize();
      c_lns.Add(new Line(ln.From, vec * ln.Length * rate));
    }
    A = c_lns;
# ---------- end c_script ----------
internal_forces = _1InternalForcesVGS(Ln=cem_extract_structure_2_0.Trails, Mag=multiplication_2)
internal_forces_2 = _1InternalForcesVGS(Ln=cem_extract_structure_2_0.Deviations, Mag=multiplication)
external_forces = _2ExternalForcesVGS(ForceLn=c_script.A)
assemble_form_diagram = _3AssembleFormDiagramVGS(IntForce=flatten([internal_forces, internal_forces_2]), ExtForce=flatten(external_forces))
readrhino_force_diagram = _3ReadRhinoDiagramVGS(F=assemble_form_diagram, ObjGuids=id, Run=button)
locate_diagram = _2LocateDiagramVGS(FF=assemble_form_diagram, LocPt=pt_2)
data = Data(locate_diagram)

panel_6 = Panel("""v46
v42
v38
v34
v30
v26
v22
v18
v14
v10
v5
v4
v7
v8
v12
v16
v20
v24
v28
v32
v36
v40
v44
v48
v50
v51
v47
v49""")
select_nodes = _3SelectNodesVGS(FF=data, NodesID=panel_6)
select_nodes_2 = _3SelectNodesVGS(FF=data, NodesID="v7")
xy = XYPlane(Origin=select_nodes_2)
onplane = OnPlane(Points=select_nodes, Plane=xy, Strength=Slider(0.01, range=0.01..5))

locate_diagram_2 = _2LocateDiagramVGS(FF=readrhino_force_diagram, LocPt=pt)

panel_7 = Panel("""e42
e38
e34
e30
e26
e22
e18
e14
e10
e6
e2
e68
e4
e8
e12
e16
e20
e24
e28
e32
e36
e40
e44""")
panel_8 = Panel("""e41
e37
e33
e29
e25
e21
e17
e13
e9
e5
e1
e69
e0
e3
e7
e11
e15
e19
e23
e27
e31
e35
e39""")
panel_9 = Panel("""e67
e66
e65
e64
e63
e62
e61
e60
e59
e58
e56
e57
e53
e54
e55
e50
e51
e52
e46
e47
e48
e49""")
number_slider_4 = Slider(0.1, range=0.1..5)
select_edges = _4SelectEdgesVGS(FF=data, EdgesID=panel_7)
select_edges_2 = _4SelectEdgesVGS(FF=locate_diagram_2, EdgesID=panel_9)
select_edges_3 = _4SelectEdgesVGS(FF=data, EdgesID=panel_8)
equallength = EqualLength(Line=select_edges, Strength=number_slider_4)
equallength_2 = EqualLength(Line=select_edges_2, Strength=number_slider_4)
equallength_3 = EqualLength(Line=select_edges_3, Strength=number_slider_4)

select_nodes_3 = _3SelectNodesVGS(FF=data, NodesID=panel_4)
select_nodes_4 = _3SelectNodesVGS(FF=data, NodesID=panel_3)
select_nodes_5 = _7SelectNodesVGS(FF=locate_diagram_2, NodeID="V1")
anchor = Anchor(Point=select_nodes_5, Target=select_nodes_5, Strength=10000)
move_2 = Move(Geometry=select_nodes_3, Motion=expr("-x", Y_2))  # -> Geometry, Transform
move_3 = Move(Geometry=select_nodes_4, Motion=Y_2)  # -> Geometry, Transform
anchor_2 = Anchor(Point=flatten(select_nodes_4), Target=flatten(move_3.Geometry), Strength=number_slider_2)
anchor_3 = Anchor(Point=flatten(select_nodes_3), Target=flatten(move_2.Geometry), Strength=number_slider_2)
merge_2 = Merge(
    Data1=flatten(equallength),
    Data2=flatten(equallength_2),
    Data3=flatten(anchor_2),
    Data4=flatten(anchor_3),
    Data5=flatten(onplane),
    Data6=flatten(equallength_3))
transformation = _1TransformationVGS(F=locate_diagram, F_2=locate_diagram_2, Goals=merge_2, Constr=merge, Reset=Button(), Run=Toggle(True))  # -> F, F_2, Iteration, Output
panel_10 = Panel(transformation.Iteration)
visualize_diagrams = _1VisualizeDiagramsVGS(
    FF=transformation.F,
    ThickLn=0.1,
    ThickLnVar=1,
    SizeTxt=0.6,
    NodeID=2147483647,
    display_Edge_line=True,
    display_Edge_text=False,
    display_Load_line=False,
    display_Load_text=False,
    display_Node_circle=True,
    display_Node_text=True,
    display_React_line=True,
    display_React_text=True,
    display_Result_line=True,
    display_Result_text=True)
visualize_diagrams_2 = _1VisualizeDiagramsVGS(
    FF=transformation.F_2,
    ThickLn=0.08,
    ThickLnVar=1,
    SizeTxt=0.3,
    NodeID=2147483647,
    display_Edge_line=True,
    display_Edge_text=False,
    display_Load_line=True,
    display_Load_text=False,
    display_Node_circle=True,
    display_Node_text=True,
    display_React_line=True,
    display_React_text=True,
    display_Result_line=True,
    display_Result_text=True)
select_edges_4 = _4SelectEdgesVGS(FF=transformation.F, EdgesID=panel_5)
extract_form_diagram = _8ExtractFormDiagramVGS(F=transformation.F)  # -> EdgesID, EdgesLn, EdgesCol, EdgesMag, NodesID, NodesPt, NodesCol, NodesNodeAdj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
join = JoinCurves(Curves=select_edges_4, Preserve=False)
offset = OffsetCurve(Curve=join, Distance=expr("x*-1", number_slider_3), Plane=PlaneXY(0, 0, 0), Corners=1)
offset_2 = OffsetCurve(Curve=join, Distance=number_slider_3, Plane=PlaneXY(0, 0, 0), Corners=1)
rulesrf = RuledSurface(CurveA=offset, CurveB=offset_2)
preview = CustomPreview(Geometry=rulesrf, Material=rgb)
