# Grasshopper definition 3D_Tensegrity.gh (Grasshopper 1.0.7)
# plug-ins: VGS1.00beta, Kangaroo2 Components

number_slider = Slider(5, range=-10..10)
crv = Curve([<curve referenced from the Rhino model> x9])
crv_2 = Curve([<curve referenced from the Rhino model> x3])
neg = Negative(Value=number_slider)
lng = ListLength(List=crv)
lng_2 = ListLength(List=crv_2)
dup = DuplicateData(Data=number_slider, Number=lng, Order=True)
dup_2 = DuplicateData(Data=neg, Number=lng_2, Order=True)
internal_forces = _1InternalForcesVGS(Ln=crv, Mag=dup)
internal_forces_2 = _1InternalForcesVGS(Ln=crv_2, Mag=dup_2)
assemble_form_diagram = _3AssembleFormDiagramVGS(IntForce=[internal_forces, internal_forces_2])
extract_form_diagram = _8ExtractFormDiagramVGS(F=assemble_form_diagram)  # -> EdgeID, EdgeLn, EdgeCol, EdgeMag, NodesID, NodePt, NodeNodeAdj, NodeEdgeAdj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
generate_force_diagram = _4GenerateForceDiagramVGS(F=assemble_form_diagram, GlobEq=True, Reset=Button(), FormFinding=False)
number_slider_2 = Slider(1, range=0..10)
pt = Point(<point referenced from the Rhino model>)
constrain_node = _6ConstrainNodeVGS(NodesID=extract_form_diagram.NodesID, Strength=10, XYZ0=False, XYZ1=False, XYZ2=True)
locate_diagram = _2LocateDiagramVGS(FF=generate_force_diagram, LocPt=pt)
interdependency_config = _3InterdependencyConfigVGS(
    ParallelStrength=number_slider_2,
    DuplicateStrength=number_slider_2,
    CoincidentNodesStrength=number_slider_2,
    ClosePolygonStrength=number_slider_2)
simulation_config = _2SimulationConfigVGS(FrameGap=1e-08, TimeGap=50, Thresh=1e-10, FormDistortion=5, ForceDistortion=5, DistortionStrength=0.1)
grab = Grab(On=True, Strength=1, Range=3)
transformation = _1TransformationVGS(
    F=assemble_form_diagram,
    F_2=locate_diagram,
    Goals=grab,
    Constr=flatten(constrain_node),
    SimConfig=simulation_config,
    InterConfig=interdependency_config,
    Reset=Button(),
    Run=Toggle(True))  # -> F, F_2, Iteration, Output
diagrams_evaluation = _3DiagramsEvaluationVGS(F=transformation.F, F_2=transformation.F_2, AngTol=0.02, LenTol=0.001)  # -> Convergence, UnparEdge, UndupEdge, LoadPath
visualize_diagrams = _1VisualizeDiagramsVGS(
    FF=transformation.F,
    ThickLn=0.1,
    ThickLnVar=1,
    SizeTxt=0.1,
    NodeID=2147483647,
    display_Edge_line=True,
    display_Edge_text=True,
    display_Load_line=True,
    display_Load_text=False,
    display_Node_circle=True,
    display_Node_text=True,
    display_React_line=False,
    display_React_text=False,
    display_Result_line=False,
    display_Result_text=False)
visualize_diagrams_2 = _1VisualizeDiagramsVGS(
    FF=transformation.F_2,
    ThickLn=0.1,
    ThickLnVar=1,
    SizeTxt=0.1,
    NodeID=2147483647,
    display_Edge_line=True,
    display_Edge_text=True,
    display_Load_line=True,
    display_Load_text=False,
    display_Node_circle=True,
    display_Node_text=True,
    display_React_line=False,
    display_React_text=False,
    display_Result_line=False,
    display_Result_text=False)
panel = Panel(diagrams_evaluation.Convergence)
