# Grasshopper definition SurfaceStructure_CEM_IO.gh (Grasshopper 1.0.7)
# plug-ins: CEM_Build_Topology_2.0, CEM_Trail_2.0, CEM_Deviation_2.0, CEM_Support_2.0, CEM_Load_2.0, CEM_Calculate_Structure_2.0, CEM_Extract_Structure_2.0, VGS1.00beta

v3 = Slider(0.07, range=-2..2)
v4 = Slider(-1.12, range=-2..2)
pt = Point(Point(5.340217841, 135.0866549, 0))
c_script = CSharpScript(
    centralPoint=pt,
    v1=Slider(0.79, range=-2..2),
    v2=Slider(-1.44, range=-2..2),
    v3=v3,
    v4=v4,
    trail_lens=Slider(-3.821, range=-10..10),
    divide=Slider(12, range=0..40),
    layers=Slider(6, range=0..10))  # -> out, ori_pts, sup_pts, DEVI, Devi_mag, TRAIL, Trail_len, Pts_all; inputs centralPoint: Point3d, v1: Double, v2: Double, v3: Double, v4: Double, trail_lens: Double, divide: Int32, layers: Int32
# ---------- c_script: C# ----------
    List<List<Point3d>> Pts = new List<List<Point3d>>(divide);
    double unit = 5.0;
    List<Point3d> st_pts = new List<Point3d>();
    List<Point3d> ed_pts = new List<Point3d>();
    //Frame Construction
    for(int i = 0;i < divide;i++)
    {
      Pts.Add(new List<Point3d>(layers));
      for(int j = 0;j < layers;j++)
      {
        Point3d temp_pt = new Point3d((j + 1) * unit + centralPoint.X, centralPoint.Y, centralPoint.Z);
        Transform trans_temp = transformation(System.Math.PI * 2 / divide * i, centralPoint);
        temp_pt.Transform(trans_temp);
        Pts[i].Add(temp_pt);

        if(j == 0){st_pts.Add(temp_pt);}
        if(j == layers - 1){ed_pts.Add(temp_pt);}
      }
    }

    //Construct dir_deviation
    List<List<Line>> dir_devi = new List<List<Line>>();

    for(int j = 0;j < layers;j++)
    {
      dir_devi.Add(new List<Line>());
      for(int i = 0;i < divide;i++)
      {
        if(i == divide - 1){dir_devi[j].Add(new Line(Pts[i][j], Pts[0][j]));}
        else{dir_devi[j].Add(new Line(Pts[i][j], Pts[i + 1][j]));}
      }
    }

    //Set the dir_deviation mag
    List<List<double>> dir_devi_mag = new List<List<double>>();
    for(int j = 0;j < layers;j++)
    {
      dir_devi_mag.Add(new List<double>());
      for(int i = 0;i < divide;i++)
      {
        // if(j == 0)
        // {dir_devi_mag[j].Add(-1);continue;}

        if(i % 2 == 1)
        {
          if(j % 2 == 1)//奇数排
          {dir_devi_mag[j].Add(v1 / System.Math.Pow(j + 1, 1));}//-0.3
          else//偶数排
          {dir_devi_mag[j].Add(v2 / System.Math.Pow(j + 1, 1));}
        }
        else
        {
          if(j % 2 == 1)
          {dir_devi_mag[j].Add(v3 / System.Math.Pow(j + 1, 1));}
          else
          {dir_devi_mag[j].Add(v4 / System.Math.Pow(j + 1, 1));}
        }
      }
    }

    //Construct trails
    List<List<Line>> trail = new List<List<Line>>();
    for(int i = 0;i < divide;i++)
    {
      trail.Add(new List<Line>());
      for(int j = 0;j < layers - 1;j++)
      {
        trail[i].Add(new Line(Pts[i][j], Pts[i][j + 1]));
      }
    }
    //trail lengths
    List<List<double>> trail_len = new List<List<double>>();
    for(int i = 0;i < divide;i++)
    {
      trail_len.Add(new List<double>());
      for(int j = 0;j < layers - 1;j++)
      {
        trail_len[i].Add(trail_lens);
      }
    }

    List < Point3d > Present = new List<Point3d>();
    foreach(List<Point3d> pts in Pts)
    {
      Present.AddRange(pts);
    }
    ori_pts = st_pts;
    sup_pts = ed_pts;
    DEVI = PlantTreeLine(dir_devi);
    Devi_mag = PlantTreeDouble(dir_devi_mag);
    TRAIL = PlantTreeLine(trail);
    Trail_len = PlantTreeDouble(trail_len);
    Pts_all = Present;
# ---------- c_script: C# additional code ----------
  public Transform transformation(double angle, Point3d central)
  {
    Transform trans = Rhino.Geometry.Transform.Rotation(angle, new Vector3d(0, 0, 1), central);
    return trans;
  }
  public DataTree<Line> PlantTreeLine(List<List<Line>>lineline)
  {
    DataTree<Line> temp = new DataTree<Line>();
    for(int i = 0;i < lineline.Count;i++)
    {
      GH_Path path = new GH_Path(i);
      temp.AddRange(lineline[i], path);
    }

    return temp;
  }

  public DataTree<double> PlantTreeDouble(List<List<double>>dd)
  {
    DataTree<double> temp = new DataTree<double>();
    for(int i = 0;i < dd.Count;i++)
    {
      GH_Path path = new GH_Path(i);
      temp.AddRange(dd[i], path);
    }

    return temp;
  }
# ---------- end c_script ----------
pt_2 = Point(c_script.Pts_all)
pt_3 = Point(c_script.sup_pts)
v4_2 = Slider(-0.2, range=-2..2)
difference = SetDifference(SetA=pt_2, SetB=pt_3)
cem_trail_2_0 = CEM_Trail_20(TrailEdge=c_script.TRAIL, TrailLen=c_script.Trail_len)  # -> flatten(T)
cem_support_2_0 = CEM_Support_20(Support=c_script.sup_pts)
cem_deviation_2_0 = CEM_Deviation_20(DeviationEdge=c_script.DEVI, DeviationMagn=c_script.Devi_mag)  # -> flatten(D)
pt_4 = Point(difference)
cem_load_2_0 = CEM_Load_20(PointLoad=pt_4, LoadMagnZ=v4_2)
cem_build_topology_2_0 = CEM_Build_Topology_20(T=cem_trail_2_0, L=cem_load_2_0, D=cem_deviation_2_0, S=cem_support_2_0)
cem_calculate_structure_2_0 = CEM_Calculate_Structure_20(MarshallingSignalParameter=cem_build_topology_2_0)
cem_extract_structure_2_0 = CEM_Extract_Structure_20(M=cem_calculate_structure_2_0)  # -> Nodes, NodesID, Trails, TrailsID, TrailsCol, TrailsMag, Deviations, DeviationsID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
len = Length(Curve=cem_extract_structure_2_0.ExternalForces)
merge = Merge(Data1=cem_extract_structure_2_0.TrailsMag, Data2=cem_extract_structure_2_0.DeviationsMag)
merge_2 = Merge(Data1=cem_extract_structure_2_0.Trails, Data2=cem_extract_structure_2_0.Deviations)
larger = LargerThan(FirstNumber=len, SecondNumber=0)  # -> LargerThan, OrEqualTo
internal_forces = _1InternalForcesVGS(EdgeLn=merge_2, EdgeMag=merge)
dispatch = Dispatch(List=cem_extract_structure_2_0.ExternalForces, DispatchPattern=larger.LargerThan)  # -> ListA, ListB
external_forces = _2ExternalForcesVGS(ExtForceLn=dispatch.ListA)
assemble_form_diagram = _3AssembleFormDiagramVGS(IntForce=internal_forces, ExtForce=external_forces)
pt_5 = Point(Point(63.44596672, 134.040513, 0))
visualize_diagrams = _1VisualizeDiagramsVGS(
    FF=assemble_form_diagram,
    ThickLn=2,
    ThickLnVar=1,
    SizeTxt=0.3,
    NodeID=2147483647,
    display_Edge_line=True,
    display_Edge_text=False,
    display_Load_line=True,
    display_Load_text=False,
    display_Node_circle=True,
    display_Node_text=False,
    display_React_line=True,
    display_React_text=True,
    display_Result_line=True,
    display_Result_text=True)

crv = Curve(flatten(c_script.TRAIL))
crv_2 = Curve(flatten(c_script.DEVI))
num = Number(c_script.Trail_len)
num_2 = Number(c_script.Devi_mag)
c_script_2 = CSharpScript(db=flatten(num_2))  # -> out, R, G, B; inputs db: Double
# ---------- c_script_2: C# ----------
    if(db > 0){R = 228;G = 7;B = 20;}
    else if (db < 0){R = 5;G = 120;B = 191;}
# ---------- end c_script_2 ----------
rgb = ColourRGB(Alpha=255, Red=127, Green=0, Blue=0)
rgb_2 = ColourRGB(Alpha=255, Red=150, Green=150, Blue=150)
preview = CustomPreview(Geometry=crv, Material=rgb)
preview_2 = CustomPreview(Geometry=crv_2, Material=rgb_2)
midpt = CurveMiddle(Curve=crv_2)
rgb_3 = ColourRGB(Alpha=255, Red=c_script_2.R, Green=c_script_2.G, Blue=c_script_2.B)
midpt_2 = CurveMiddle(Curve=crv)
tag = TextTag3D(Location=midpt_2, Text=flatten(num), Size=1, Colour=rgb, Justification=2)
tag_2 = TextTag3D(Location=midpt, Text=flatten(num_2), Size=1, Colour=rgb_3, Justification=2)

surfacestructure_cem = _1SurfaceStructure_CEM(
    F=assemble_form_diagram,
    CemTrails=cem_extract_structure_2_0.Trails,
    SelectBoundary=Slider(1, range=0..10),
    Reset=Toggle(True))

locate_diagram = _2LocateDiagramVGS(FF=surfacestructure_cem, LocPt=pt_5)
visualize_diagrams_2 = _1VisualizeDiagramsVGS(
    FF=locate_diagram,
    ThickLn=1,
    ThickLnVar=1,
    SizeTxt=0.02,
    NodeID=Slider(100, range=0..100),
    display_Edge_line=True,
    display_Edge_text=False,
    display_Load_line=True,
    display_Load_text=False,
    display_Node_circle=True,
    display_Node_text=False,
    display_React_line=True,
    display_React_text=True,
    display_Result_line=True,
    display_Result_text=True)
