# Grasshopper definition _CEM-shell-trail-guided-forcediagram.gh (Grasshopper 1.0.8)
# plug-ins: CEM_Trail_2.0, CEM_Deviation_2.0, VGS_vector-based_graphic_statics, CEM_Build_Topology_2.0, CEM_Calculate_Structure_2.0, CEM_Support_2.0, CEM_Extract_Structure_2.0, CEM_Load_2.0

v3 = Slider(1.28, range=-2..2)
v4 = Slider(0.57, range=-2..2)
pt = Point(Point(5.340217841, 135.0866549, 0))
c_script = CSharpScript(
    centralPoint=pt,
    v1=Slider(0.15, range=-2..2),
    v2=Slider(1.03, range=-2..2),
    v3=v3,
    v4=v4,
    trail_lens=Slider(3, range=-10..10),
    divide=Slider(10, range=0..40),
    layers=Slider(4, range=0..10))  # -> out, ori_pts, sup_pts, DEVI, Devi_mag, TRAIL, Trail_len, Pts_all; inputs centralPoint: Point3d, v1: Double, v2: Double, v3: Double, v4: Double, trail_lens: Double, divide: Int32, layers: Int32
# ---------- c_script: C# ----------
    List<List<Point3d>> Pts = new List<List<Point3d>>(divide);
    double unit = 5.0;
    List<Point3d> st_pts = new List<Point3d>();
    List<Point3d> ed_pts = new List<Point3d>();
    //Frame Construction
    for(int i = 0;i < divide;i++)
    {
      Pts.Add(new List<Point3d>(layers));
      for(int j = 0;j < layers;j++)
      {
        Point3d temp_pt = new Point3d((j + 1) * unit + centralPoint.X, centralPoint.Y, centralPoint.Z);
        Transform trans_temp = transformation(System.Math.PI * 2 / divide * i, centralPoint);
        temp_pt.Transform(trans_temp);
        Pts[i].Add(temp_pt);

        if(j == 0){st_pts.Add(temp_pt);}
        if(j == layers - 1){ed_pts.Add(temp_pt);}
      }
    }

    //Construct dir_deviation
    List<List<Line>> dir_devi = new List<List<Line>>();

    for(int j = 0;j < layers;j++)
    {
      dir_devi.Add(new List<Line>());
      for(int i = 0;i < divide;i++)
      {
        if(i == divide - 1){dir_devi[j].Add(new Line(Pts[i][j], Pts[0][j]));}
        else{dir_devi[j].Add(new Line(Pts[i][j], Pts[i + 1][j]));}
      }
    }

    //Set the dir_deviation mag
    List<List<double>> dir_devi_mag = new List<List<double>>();
    for(int j = 0;j < layers;j++)
    {
      dir_devi_mag.Add(new List<double>());
      for(int i = 0;i < divide;i++)
      {
        // if(j == 0)
        // {dir_devi_mag[j].Add(-1);continue;}

        if(i % 2 == 1)
        {
          if(j % 2 == 1)//奇数排
          {dir_devi_mag[j].Add(v1 / System.Math.Pow(j + 1, 1));}//-0.3
          else//偶数排
          {dir_devi_mag[j].Add(v2 / System.Math.Pow(j + 1, 1));}
        }
        else
        {
          if(j % 2 == 1)
          {dir_devi_mag[j].Add(v3 / System.Math.Pow(j + 1, 1));}
          else
          {dir_devi_mag[j].Add(v4 / System.Math.Pow(j + 1, 1));}
        }
      }
    }

    //Construct trails
    List<List<Line>> trail = new List<List<Line>>();
    for(int i = 0;i < divide;i++)
    {
      trail.Add(new List<Line>());
      for(int j = 0;j < layers - 1;j++)
      {
        trail[i].Add(new Line(Pts[i][j], Pts[i][j + 1]));
      }
    }
    //trail lengths
    List<List<double>> trail_len = new List<List<double>>();
    for(int i = 0;i < divide;i++)
    {
      trail_len.Add(new List<double>());
      for(int j = 0;j < layers - 1;j++)
      {
        trail_len[i].Add(trail_lens);
      }
    }

    List < Point3d > Present = new List<Point3d>();
    foreach(List<Point3d> pts in Pts)
    {
      Present.AddRange(pts);
    }
    ori_pts = st_pts;
    sup_pts = ed_pts;
    DEVI = PlantTreeLine(dir_devi);
    Devi_mag = PlantTreeDouble(dir_devi_mag);
    TRAIL = PlantTreeLine(trail);
    Trail_len = PlantTreeDouble(trail_len);
    Pts_all = Present;
# ---------- c_script: C# additional code ----------
  public Transform transformation(double angle, Point3d central)
  {
    Transform trans = Rhino.Geometry.Transform.Rotation(angle, new Vector3d(0, 0, 1), central);
    return trans;
  }
  public DataTree<Line> PlantTreeLine(List<List<Line>>lineline)
  {
    DataTree<Line> temp = new DataTree<Line>();
    for(int i = 0;i < lineline.Count;i++)
    {
      GH_Path path = new GH_Path(i);
      temp.AddRange(lineline[i], path);
    }

    return temp;
  }

  public DataTree<double> PlantTreeDouble(List<List<double>>dd)
  {
    DataTree<double> temp = new DataTree<double>();
    for(int i = 0;i < dd.Count;i++)
    {
      GH_Path path = new GH_Path(i);
      temp.AddRange(dd[i], path);
    }

    return temp;
  }
# ---------- end c_script ----------
pt_2 = Point(c_script.Pts_all)
pt_3 = Point(c_script.sup_pts)
v4_2 = Slider(-0.2, range=-2..2)
difference = SetDifference(SetA=pt_2, SetB=pt_3)
cem_trail_2_0 = CEM_Trail_20(TrailEdge=c_script.TRAIL, TrailLen=c_script.Trail_len)  # -> flatten(T)
cem_deviation_2_0 = CEM_Deviation_20(DeviationEdge=c_script.DEVI, DeviationMagn=c_script.Devi_mag)  # -> flatten(D)
cem_support_2_0 = CEM_Support_20(Support=c_script.sup_pts)
pt_4 = Point(difference)
# CEM Ouput+Form Diagram
cem_load_2_0 = CEM_Load_20(PointLoad=pt_4, LoadMagnZ=v4_2)
cem_build_topology_2_0 = CEM_Build_Topology_20(T=cem_trail_2_0, L=cem_load_2_0, D=cem_deviation_2_0, S=cem_support_2_0)
cem_calculate_structure_2_0 = CEM_Calculate_Structure_20(MarshallingSignalParameter=cem_build_topology_2_0)
cem_extract_structure_2_0 = CEM_Extract_Structure_20(M=cem_calculate_structure_2_0)  # -> Nodes, NodesID, Trails, TrailsID, TrailsCol, TrailsMag, Deviations, DeviationsID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

crv = Curve(cem_extract_structure_2_0.Trails)

merge = Merge(Data1=cem_extract_structure_2_0.Trails, Data2=cem_extract_structure_2_0.Deviations)
merge_2 = Merge(Data1=cem_extract_structure_2_0.TrailsMag, Data2=cem_extract_structure_2_0.DeviationsMag)

sub_equilibrium_system = _3SubEquilibriumSystemVGS(EdgeLn=merge, EdgeMag=merge_2, Nodes=cem_extract_structure_2_0.Nodes, Scale=1, Tol=0.0001)  # -> EdgeLn, EdgeMag, ExtForceLn
external_forces = _2ExternalForcesVGS(ExtForceLn=sub_equilibrium_system.ExtForceLn)
internal_forces = _1InternalForcesVGS(EdgeLn=sub_equilibrium_system.EdgeLn, EdgeMag=sub_equilibrium_system.EdgeMag)

assemble_form_diagram = _3AssembleFormDiagramVGS(IntForce=internal_forces, ExtForce=external_forces)
pt_5 = Point(Point(5.340217841, 166.783417, 0))
trailguided_force_diagram = _5TrailGuidedForceDiagramVGSFold(F=assemble_form_diagram, T=cem_extract_structure_2_0.Trails, I=1, Run=Toggle(True))
locate_diagram = _2LocateDiagramVGS(FF=trailguided_force_diagram, LocPt=pt_5, Scale=5)
visualize_diagrams = _1VisualizeDiagramsVGS(
    FF=assemble_form_diagram,
    ThickLn=1,
    ThickLnVar=1,
    SizeTxt=0.3,
    NodeID=-1,
    display_Edge_line=True,
    display_Edge_text=False,
    display_Load_line=True,
    display_Load_text=False,
    display_Node_circle=True,
    display_Node_text=False,
    display_React_line=True,
    display_React_text=True,
    display_Result_line=True,
    display_Result_text=True)
visualize_diagrams_2 = _1VisualizeDiagramsVGS(
    FF=locate_diagram,
    ThickLn=1,
    ThickLnVar=1,
    SizeTxt=0.3,
    NodeID=-1,
    display_Edge_line=True,
    display_Edge_text=False,
    display_Load_line=True,
    display_Load_text=False,
    display_Node_circle=True,
    display_Node_text=False,
    display_React_line=True,
    display_React_text=True,
    display_Result_line=True,
    display_Result_text=True)

num = Number(c_script.Trail_len)
crv_2 = Curve(flatten(c_script.TRAIL))
crv_3 = Curve(flatten(c_script.DEVI))
num_2 = Number(c_script.Devi_mag)
c_script_2 = CSharpScript(db=flatten(num_2))  # -> out, R, G, B; inputs db: Double
# ---------- c_script_2: C# ----------
    if(db > 0){R = 228;G = 7;B = 20;}
    else if (db < 0){R = 5;G = 120;B = 191;}
# ---------- end c_script_2 ----------
midpt = CurveMiddle(Curve=crv_3)
rgb = ColourRGB(Alpha=255, Red=c_script_2.R, Green=c_script_2.G, Blue=c_script_2.B)
midpt_2 = CurveMiddle(Curve=crv_2)
tag = TextTag3D(Location=midpt, Text=flatten(num_2), Size=0.8, Colour=rgb, Justification=2)

c_script_3 = CSharpScript(db=flatten(num_2))  # -> out, R, G, B; inputs db: Double; same code as c_script_2
c_script_4 = CSharpScript(db=flatten(num))  # -> out, R, G, B; inputs db: Double; same code as c_script_2

rgb_2 = ColourRGB(Alpha=255, Red=c_script_4.R, Green=c_script_4.G, Blue=c_script_4.B)
rgb_3 = ColourRGB(Alpha=255, Red=c_script_3.R, Green=c_script_3.G, Blue=c_script_3.B)
preview = CustomPreview(Geometry=crv_2, Material=rgb_2)
preview_2 = CustomPreview(Geometry=crv_3, Material=rgb_3)
tag_2 = TextTag3D(Location=midpt_2, Text=flatten(num), Size=1, Colour=rgb_2, Justification=2)
